# Grasshopper definition GA_02.gh (Grasshopper 1.0.7)

ghpython_script = GhPythonScript(Toggle=Toggle(True))  # -> out, resultado
# ---------- ghpython_script: Python ----------
__author__ = "Renato Godoi da Cruz"
__version__ = "2020.08.20"


import rhinoscriptsyntax as rs

from random import random, randint

class Parameter():
    """No Grasshopper, todo paamêtro tem 1 nome e um valor que vai de um min até um max."""
    def __init__(self, name, minimum, maximum):    #o valor entra nesse algoritmo
        self.name = name                         #parametro nome. Ex.: largura
        self.minimum = minimum                     #parametro min. Ex.: 1
        self.maximum = maximum                     #parametro max. Ex.: 10

#o cromossomo (str) será o conjuntos dos valores (escolhidos entre o min e o max)
#o individuo será o próprio cromossomo
class Individual():
    """Definição"""
    def __init__(self, minimums, maximums, generation=0):
        self.minimums = minimums
        self.maximums = maximums
        self.grade_evaluation = 0
        self.generation = generation
        self.chromosome = []                     #valores entre min e max dos parametros

        for i in range(len(list_parameters)):   #escolher valores entre min e max aleatoriamente
            if (type(minimums[i]) == float) and (type(maximums[i]) == float):
                self.chromosome.append(random.uniform(minimums[i], maximums[i])) #instance
            else:
                self.chromosome.append(randint(minimums[i], maximums[i])) 

    def evaluation(self):
        """Função fitness"""
        #Aqui deve receber o valor_objetivo de cada individuo (vem do modelo) Por exemplo, relação área/volume
        grade =randint(1000, 2222) #função provisório para continuar o desenv. script #NOTA
        self.grade_evaluation = grade

    def crossover(self, another_individual):
        """Determina o ponto de crossover"""
        cut = int(round(random()  * len(self.chromosome))) #um número randômico (0 ou 1) vai multiplicar pelo tamanho do cromossomo (round é para arredondar)

        
        child1 = another_individual.chromosome[0:cut] + self.chromosome[cut::]  #o filho recebe parte do cromossomo (de 0 até corte) do outro indíviduo
        child2 = self.chromosome[0:cut] + another_individual.chromosome[cut::]  #o outro_ind é o individuo2 

        children = [Individual(self.minimums, self.maximums, self.generation + 1),
                  Individual(self.minimums, self.maximums, self.generation + 1)]
        children[0].chromosome = child1   #filho 1 e 2 na verdade está criando cromossomos
        children[1].chromosome = child2
        return children

    def mutation(self, mutation_rate):
        """Determina a mutação dos cromossomos""" 
        for i in range(len(self.chromosome)):
            if random() < mutation_rate:
                if (type(minimums[i]) == float) and (type(maximums[i]) == float):
                    self.chromosome[i] = random.uniform(minimums[i], maximums[i]) #instance
                else:
                    self.chromosome[i] = randint(minimums[i], maximums[i]) 
        return self

class GeneticAlgorithm():
    def __init__(self, population_size):
        self.population_size = population_size
        self.population = []
        self.generation = 0
        self.best_solution = 0

    def initializes_population(self, minimums, maximums):
        for i in range(self.population_size):
            self.population.append(Individual(minimums, maximums))
        self.best_solution = self.population[0] 






    def orders_population(self):
        #AQUI DEVE ENTRAR SE É MINIMIZAÇÃO OU MAXIMIZAÇÃO
        self.population = sorted(self.population,
                                key = lambda population: population.grade_evaluation,
                                reverse = True) 
        """
        self.population = sorted(self.population,
                                key = lambda population: population.grade_evaluation)
        """

        #HÁ ALTERAÇÃO NOS VALORES, MAS AINDA NÃO ENTENDO SE ESTÁ BOM OU NÃO :/
        #AINDA A MELHOR SOLUÇÃO NÃO É O MENOR NÚMERO


    def melhor_individuo(self, individuo):
        if individuo.grade_evaluation > self.best_solution.grade_evaluation:
            self.best_solution = individuo

    def soma_avaliacoes(self):
        soma = 0
        for individuo in self.population:
            soma += individuo.grade_evaluation
        return soma

    def seleciona_pai(self, soma_avaliacao):
        """Seleção dos indivíduos - método Roleta Viciada"""
        pai = -1
        valor_sorteado = random() * soma_avaliacao
        soma = 0
        i = 0
        while i < len(self.population) and soma < valor_sorteado:
            soma += self.population[i].grade_evaluation
            pai += 1
            i += 1
        return pai


#AQUI PRECISA SAÍR COMO INPUT E NÃO COMO IMPRESSÃO

    def visualiza_geracao(self): #DADOS DO GA(raspar para uma planilha Excel)
        melhor = self.population[0]
        saida = melhor.chromosome
        print(saida) #COMO FAZER ISSO SAIR POR OUTPUT?????
        return saida
        #print("G:%s --> Valor: %s Cromossomo: %s" % (self.population[0].generation,
                                                     #melhor.grade_evaluation,
                                                     #melhor.chromosome))

#ACIMA TAMBÉM DEVE SER O RASPADOR DE DADOS


    def resolver(self, mutation_rate, numero_geracao):
        self.initializes_population(minimums, maximums)

        for individuo in self.population:                #primeira geração (aleatória)
            individuo.evaluation()

        self.orders_population()
        self.visualiza_geracao()

        for generation in range(numero_geracao):           #gerações novas
            soma_avaliacao = self.soma_avaliacoes()
            nova_populacao = []

            for individuos_gerados in range(0, self.population_size, 2):
                pai1 = self.seleciona_pai(soma_avaliacao)
                pai2 = self.seleciona_pai(soma_avaliacao)

                filhos = self.population[pai1].crossover(self.population[pai2])

                nova_populacao.append(filhos[0].mutation(mutation_rate))
                nova_populacao.append(filhos[1].mutation(mutation_rate))

            self.population = list(nova_populacao)

            for individuo in self.population:
                individuo.evaluation()

            self.orders_population()
            self.visualiza_geracao()

            melhor = self.population[0]
            self.melhor_individuo(melhor)
        
        print("\nMelhor solução -> G: %s Valor: %s Cromossomo: %s" %
              (self.best_solution.generation,
               self.best_solution.grade_evaluation,
               self.best_solution.chromosome))
        
        return self.best_solution.chromosome


if Toggle: #método __main__

    list_parameters = []
    list_parameters.append(Parameter('Altura', 1, 5))
    list_parameters.append(Parameter('Largura', 6, 10))
    list_parameters.append(Parameter('Profundidade', 11, 20))
    #for parametro in list_parameters:
        #print(parametro.nome)

    minimums = []
    maximums = []
    nomes = []
    for parametro in list_parameters:       
        minimums.append(parametro.minimum)
        maximums.append(parametro.maximum)
        nomes.append(parametro.name)

    population_size = 20
    taxa_mutacao = 0.05
    numero_geracao = 100
    ag = GeneticAlgorithm(population_size)

    #saida_inputs =           #AQUI DEVE INICILIZAR INPUTS PARA "EXPLODE TREE" PARA LIGAR AO MODELO
    #FUNÇÃO PARECIDA COM 'RESOLVER' OU BUSCAR NO 'INICILIZA' POPULAÇÃO, PARTE ALEATÓRIA

    #tipo um inicia = ag.saída #uma função para inicializar apenas um individuo para explodir as saídas

    resultado = ag.resolver(taxa_mutacao, numero_geracao)
# ---------- end ghpython_script ----------
ghpython_script_2 = GhPythonScript()  # -> out, a
# ---------- ghpython_script_2: Python ----------
__author__ = "Renato"
__version__ = "2020.09.09"

import rhinoscriptsyntax as rs
"""
a = []

for i in range(0,2):
    for j in range(0,3):
        a.append([i,j])

print a
"""


a = []

for i in range(5):
    a.append(i)

print a
# ---------- end ghpython_script_2 ----------
data_recorder = DataRecorder(ghpython_script_2.a, DataLimit=-10, RecordData=True)
data_recorder_2 = DataRecorder(ghpython_script.resultado, DataLimit=-10, RecordData=True)
panel = Panel(ghpython_script_2.out)
panel_2 = Panel(ghpython_script.out)
param_viewer = ParamViewer(ghpython_script.resultado)
panel_3 = Panel(data_recorder_2)
panel_4 = Panel(data_recorder)
