# Grasshopper definition GA_generico.gh (Grasshopper 0.9.76)
# plug-ins: Python Interpreter

panel = Panel("optimum")

# ---- group: Launcher
toggle = BooleanToggle(True)

# ----
python = PythonScript(Toggle=toggle)  # -> out, a
# ---------- python: Python ----------
"""
Created on Mon May 14 15:18 PM 2020
@author: Renato Godoi da Cruz
email: renatogcruz@hotmail.com
github: github.com/renatogcruz
"""

from random import random

class Parametro():
    def __init__(self, nome, minimo, maximo): #o valor entra nesse algoritmo
        self.nome = nome
        self.minimo = minimo
        self.maximo = maximo


class Individuo():
    def __init__(self, minimo, maximo, geracao=0):
        #self.valor_objetivo = valor_objetivo
        self.minimo = minimo
        self.maximo = maximo
        self.nota_avaliacao = 0
        self.geracao = geracao
        self.cromossomo = []
        
        for i in range (len(lista_parametros)):
            #print(len(lista_parametros))
            print(minimo)
            print(maximo)
            #self.cromossomo.append(random.uniform(self.minimo, self.maximo))


if Toggle:
    lista_parametros = []
    lista_parametros.append(Parametro('Altura', 1, 5))
    lista_parametros.append(Parametro('Largura', 2, 10))
    lista_parametros.append(Parametro('Profundidade', 4, 20))
    #for parametro in lista_parametros:
        #print(parametro.nome)
    
    minimo = []
    maximo = []
    nome = []
    
    for parametro in lista_parametros:
        minimo.append(parametro.minimo)
        maximo.append(parametro.maximo)
        nome.append(parametro.nome)
    
    individuo1 = Individuo(minimo,maximo)
    print("Minimo: %s" %str(individuo1.minimo))
    print("Maximo: %s" %str(individuo1.maximo))
    print("Cromossomo: %s" % str(individuo1.cromossomo))
# ---------- end python ----------
python_2 = PythonScript()  # -> out, a
# ---------- python_2: Python ----------
import random 

class Teste():
    def __init__(self, minimo, maximo):
        self.minimo = minimo
        self.maximo = maximo
        self.cromossomo = []
        
        self.cromossomo.append(random.uniform(self.minimo, self.maximo))
        



#print(random.randint(dic[0], dic[1])) #para int


teste = Teste(2,11)
print(teste.minimo)
print(teste.maximo)
print(teste.cromossomo)
# ---------- end python_2 ----------
panel_2 = Panel(python.out)

# ---- group: acessando número entre max e min
python_3 = PythonScript()  # -> out, a
# ---------- python_3: Python ----------
import random 

dic = {"name": "largura", "min": 1, "max": 10}


if (type(dic["min"]) == float) and (type(dic["max"]) == float):
	print(type(dic["min"]))
	print(random.uniform(dic["min"], dic["max"])) #para flot
else:
	print(type(dic["min"]))
	print(random.randint(dic["min"], dic["max"])) #para int
# ---------- end python_3 ----------
