# Grasshopper definition GA_passo_a_passo.gh (Grasshopper 0.9.76)
# plug-ins: Python Interpreter

python = PythonScript()  # -> out, a
# ---------- python: Python ----------
"""
Created on April 18, 2020
    @author: Renato Godoi da Cruz
    email: renatogcruz@hotmail.com
"""

from random import random

class Produto():
    """Creates the product class"""
    def __init__(self, nome, espaco, valor):
        self.nome = nome
        self.espaco = espaco
        self.valor = valor

#Classe indivíduo I 
#(indivíduos representam as soluções)
#(um conj. de individuos formam uma população)
#(O cromossomo representa uma solução)
#(O indiv. pode ser o próprio cromossomo ou pode conter o cromossomo como atributo [dependendo do caso])
#(gelad. = 0, iphone = 1, notebook = 0, ... (formam o cromossomo '0, 1, 0, ...' que nada mais é do que um conjunto de string")

class Individuo():
    def __init__(self, espacos, valores, limite_espacos, geracao=0):
        self.espacos = espacos
        self.valores = valores
        self.limite_espacos = limite_espacos
        self.nota_avaliacao = 0 #somátoria dos valores da carga
        self.espaco_usado = 0   #espaço total usado pela carga
        self.geracao = geracao
        self.cromossomo = [] #aqui vai estar contida as soluções para o nosso problema. Para ver o desempenho do individuo teremos que acessar aqui.
        
        #GERAÇÃO INICIAL este for inicia a primeira população (aleatória)
        for i in range(len(espacos)): #esse for vai de gero até o espaço que ainda tem para carregar ou não um produto
            if random() < 0.5: #gera um num. entre 0 e 1 (valores que compõe o cromossomo)
                self.cromossomo.append("0")
            else:
                self.cromossomo.append("1")

    def avaliacao(self):
        nota = 0
        soma_espacos = 0
        for i in range(len(self.cromossomo)):
           if self.cromossomo[i] == '1':
               nota += self.valores[i]
               soma_espacos += self.espacos[i]
        if soma_espacos > self.limite_espacos:
            nota = 1
        self.nota_avaliacao = nota
        self.espaco_usado = soma_espacos
        

    #CROSSOVER combina pedaços de cromossomos de dois genitores gerando filhos mais aptos
    def crossover(self, outro_individuo): 
        """Operação de crossover de um ponto"""
        corte = int(round(random() * len(self.cromossomo))) #um número randomico (0 ou 1) vai multiplicar pelo tamanho do cromossomo (round é para arredondar)

        filho1 = outro_individuo.cromossomo[0:corte] + self.cromossomo[corte::] #o filho recebe parte do cromossomo (de 0 até corte) do outro indíviduo
        filho2 = self.cromossomo[0:corte] + outro_individuo.cromossomo[corte::] #o outro_ind é o individuo2 
        
        filhos = [Individuo(self.espacos, self.valores, self.limite_espacos, self.geracao + 1),
                  Individuo(self.espacos, self.valores, self.limite_espacos, self.geracao + 1)]
        filhos[0].cromossomo = filho1 #filho 1 e 2 na verdade está criando cromossomos
        filhos[1].cromossomo = filho2
        return filhos

    def mutacao(self, taxa_mutacao):
        #print("Antes %s " % self.cromossomo)
        for i in range(len(self.cromossomo)):
            if random() < taxa_mutacao:
                if self.cromossomo[i] == '1':
                    self.cromossomo[i] = '0'
                else:
                    self.cromossomo[i] = '1'
        #print("Depois %s " % self.cromossomo)
        return self

class AlgoritmoGenetico():
    def __init__(self, tamanho_populacao):
        self.tamanho_populacao = tamanho_populacao
        self.populacao = []
        geracao = 0
        melhor_solucao = 0
    
    def inicializa_populacao(self, espacos, valores, limite_espacos):
        for i in range(self.tamanho_populacao):
            self.populacao.append(Individuo(espacos, valores, limite_espacos))
        self.melhor_solucao = self.populacao[0]
    
    def ordena_populacao(self):
        self.populacao = sorted(self.populacao, 
                                key = lambda populacao: populacao.nota_avaliacao, 
                                reverse = True)
    
    def melhor_individuo(self, individuo):
        if individuo.nota_avaliacao > self.melhor_solucao.nota_avaliacao:
            self.melhor_solucao = individuo
        
    def soma_avalicoes(self):
        soma = 0
        for individuo in self.populacao:
            soma += individuo.nota_avaliacao
        return soma
    
    #Seleção dos individuos: método da roleta viciada
    def selecao_pai(self, soma_avaliacao):
        pai = -1
        valor_sorteado = random() * soma_avaliacao
        soma = 0
        i = 0
        while i < len(self.populacao) and soma < valor_sorteado:
            soma += self.populacao[i].nota_avaliacao
            pai += 1
            i += 1
        return pai


#EXECUTOR
if __name__ == '__main__':
    #p1 = Produto("Iphone 6", 0.0000899, 2199.12)
    lista_produtos = []
    lista_produtos.append(Produto("Geladeira Dako", 0.751, 999.90))
    lista_produtos.append(Produto("Iphone 6", 0.0000899, 2911.12))
    lista_produtos.append(Produto("TV 55' ", 0.400, 4346.99))
    lista_produtos.append(Produto("TV 50' ", 0.290, 3999.90))
    lista_produtos.append(Produto("TV 42' ", 0.200, 2999.00))
    lista_produtos.append(Produto("Notebook Dell", 0.00350, 2499.90))
    lista_produtos.append(Produto("Ventilador Panasonic", 0.496, 199.90))
    lista_produtos.append(Produto("Microondas Electrolux", 0.0424, 308.66))
    lista_produtos.append(Produto("Microondas LG", 0.0544, 429.90))
    lista_produtos.append(Produto("Microondas Panasonic", 0.0319, 299.29))
    lista_produtos.append(Produto("Geladeira Brastemp", 0.635, 849.00))
    lista_produtos.append(Produto("Geladeira Consul", 0.870, 1199.89))
    lista_produtos.append(Produto("Notebook Lenovo", 0.498, 1999.90))
    lista_produtos.append(Produto("Notebook Asus", 0.527, 3999.00))
    #for produto in lista_produtos:
    #    print(produto.nome)
    
    espacos = []
    valores = []
    nomes = []
    for produto in lista_produtos:
        espacos.append(produto.espaco)
        valores.append(produto.valor)
        nomes.append(produto.nome)

    limite = 3
    
    tamanho_populacao = 20
    ag = AlgoritmoGenetico(tamanho_populacao)
    ag.inicializa_populacao(espacos, valores, limite)
    for individuo in ag.populacao:
        individuo.avaliacao()
    ag.ordena_populacao()
    ag.melhor_individuo(ag.populacao[0]) #ordenção zero é o número um do ranking
    soma = ag.soma_avalicoes()
    nova_populacao = []
    probabilidade_mutacao = 0.01
    for individuos_gerados in range(0, ag.tamanho_populacao, 2):
        pai1 = ag.selecao_pai(soma)
        pai2 = ag.selecao_pai(soma)
        
        filhos = ag.populacao[pai1].crossover(ag.populacao[pai2])
        nova_populacao.append(filhos[0].mutacao(probabilidade_mutacao))
        nova_populacao.append(filhos[1].mutacao(probabilidade_mutacao))
    
    ag.populacao = list(nova_populacao)
    for individuo in ag.populacao:
        individuo.avaliacao()
    ag.ordena_populacao()
    ag.melhor_individuo(ag.populacao[0])
    soma = ag.soma_avalicoes()
    

    #print("Soma das avaliacoes = %s" % soma)

    print("Melhor solucao para o problema: %s " % ag.melhor_solucao.cromossomo,
          "Nota = %s " % ag.melhor_solucao.nota_avaliacao)


"""
    for i in range(ag.tamanho_populacao):
        print("Individuo %s " % i,
              "Espacos = %s" % str(ag.populacao[i].espacos),
              "Valores = %s" % str(ag.populacao[i].valores),
              "Cromossomo = %s" % str(ag.populacao[i].cromossomo),
              "Nota = %s\n" % ag.populacao[i].nota_avaliacao)
        print(" ")
"""
# ---------- end python ----------
python_2 = PythonScript()  # -> out, a
# ---------- python_2: Python ----------
a = "10"
print("\ntestando %s" %a)
# ---------- end python_2 ----------
panel = Panel(python_2.out)
print = Panel(python.out)
